# Grasshopper definition WorkingCopy2.gh (Grasshopper 1.0.7)
# plug-ins: MeshEdit Components, UserDataUtils, MeshStreaming, gHowl, Weaverbird

# ----
# //Perfect maze on mesh using recursive backtracer
#     //Laurent Delrieu
#     //L.delrieu@neuf.fr
#     //V1.0 : 19 of may 2016
#     //V2.0 : 23 of May 2016 add drivers on mesh, add mesh output
# 
#     //References
#     //  http://www.astrolog.org/labyrnth/algrithm.htm
#     //  http://www.jamisbuck.org/mazes/
#     //  http://elfnor.com/maze-any-mesh-in-blender.html
#     //  http://www.grasshopper3d.com/forum/topics/wip-maze-definition
#     //TODO
#     // NGON mesh using Turtle, Plankton or new rhino 6 mesh
list = ValueList({"Square": 0, "Catadioptre": 1, "Sphere quad": 2, "Sphere triangle": 3, "Torus": 4}, selected="Square")
list_2 = ValueList({"Random Maze": 0, "Directional Maze": 1, "Try to come back Maze": 2, "Zig Zag": 3}, selected="Random Maze")

# ---- group: For directional maze
number_slider = Slider(1, range=0..1)
number_slider_2 = Slider(3, range=0..20)

# ---- group: If mesh
number_slider_3 = Slider(4.7, range=0.1..10)
toggle = BooleanToggle(True)
number_slider_4 = Slider(0.26, range=0.01..0.99)

# ---- group: Meshes / Sphere triangles
number_of_point_on_sphere = Panel("2000")
c_script = CSharpScript(
    nfaces=number_of_point_on_sphere,
    TooltipDescriptionOverride="V1.0 Laurent Delrieu l.delrieu@neuf.fr",
    TooltipTextOverride="Mesh sphere from icosaedron")  # -> out, A; inputs nfaces: Int32
# ---------- c_script: C# ----------
    int n;
    n = (int) (Math.Log10((double) nfaces / 20.0) / Math.Log10(4.0));

    double t = (1.0 + Math.Sqrt(5.0)) / 2.0;
    double c = Math.Sqrt(1 + (1.0 + Math.Sqrt(5.0)) * (1.0 + Math.Sqrt(5.0)) / 4.0);


    //Icosaedron
    Rhino.Geometry.Mesh mesh = new Rhino.Geometry.Mesh();
    mesh.Vertices.Add(-1 / c, t / c, 0);
    mesh.Vertices.Add(1 / c, t / c, 0);
    mesh.Vertices.Add(-1 / c, -t / c, 0);
    mesh.Vertices.Add(1 / c, -t / c, 0);
    mesh.Vertices.Add(0, -1 / c, t / c);
    mesh.Vertices.Add(0, 1 / c, t / c);
    mesh.Vertices.Add(0, -1 / c, -t / c);
    mesh.Vertices.Add(0, 1 / c, -t / c);
    mesh.Vertices.Add(t / c, 0, -1 / c);
    mesh.Vertices.Add(t / c, 0, 1 / c);
    mesh.Vertices.Add(-t / c, 0, -1 / c);
    mesh.Vertices.Add(-t / c, 0, 1 / c);

    mesh.Faces.AddFace(0, 11, 5);
    mesh.Faces.AddFace(0, 5, 1);
    mesh.Faces.AddFace(0, 1, 7);
    mesh.Faces.AddFace(0, 7, 10);
    mesh.Faces.AddFace(0, 10, 11);

    mesh.Faces.AddFace(1, 5, 9);
    mesh.Faces.AddFace(5, 11, 4);
    mesh.Faces.AddFace(11, 10, 2);
    mesh.Faces.AddFace(10, 7, 6);
    mesh.Faces.AddFace(7, 1, 8);

    // 5 faces around point 3
    mesh.Faces.AddFace(3, 9, 4);
    mesh.Faces.AddFace(3, 4, 2);
    mesh.Faces.AddFace(3, 2, 6);
    mesh.Faces.AddFace(3, 6, 8);
    mesh.Faces.AddFace(3, 8, 9);

    // 5 adjacent faces
    mesh.Faces.AddFace(4, 9, 5);
    mesh.Faces.AddFace(2, 4, 11);
    mesh.Faces.AddFace(6, 2, 10);
    mesh.Faces.AddFace(8, 6, 7);
    mesh.Faces.AddFace(9, 8, 1);



    for (int i = 0; i < n; i++)
    {
      Rhino.Geometry.Mesh mesh_rec = new Rhino.Geometry.Mesh();
      recursiveSubdivision(mesh, ref mesh_rec);
      mesh = mesh_rec;
    }


    mesh.Vertices.CombineIdentical(true, true);
    mesh.Normals.ComputeNormals();
    mesh.Compact();
    A = mesh;
# ---------- c_script: C# additional code ----------
  public void recursiveSubdivision(Mesh mesh, ref Mesh mesh_rec)
  {
    int ind = 0;

    for (int i = 0; i < mesh.Faces.Count; i++)
    {
      Point3f A = new Point3f(mesh.Vertices[mesh.Faces[i].A].X, mesh.Vertices[mesh.Faces[i].A].Y, mesh.Vertices[mesh.Faces[i].A].Z);
      Point3f B = new Point3f(mesh.Vertices[mesh.Faces[i].B].X, mesh.Vertices[mesh.Faces[i].B].Y, mesh.Vertices[mesh.Faces[i].B].Z);
      Point3f C = new Point3f(mesh.Vertices[mesh.Faces[i].C].X, mesh.Vertices[mesh.Faces[i].C].Y, mesh.Vertices[mesh.Faces[i].C].Z);

      ind = mesh_rec.Vertices.Count;
      mesh_rec.Vertices.Add(A);//0
      mesh_rec.Vertices.Add(middle(A, B));
      mesh_rec.Vertices.Add(B);
      mesh_rec.Vertices.Add(middle(B, C));
      mesh_rec.Vertices.Add(C);
      mesh_rec.Vertices.Add(middle(C, A));

      mesh_rec.Faces.AddFace(ind + 0, ind + 1, ind + 5);
      mesh_rec.Faces.AddFace(ind + 1, ind + 3, ind + 5);
      mesh_rec.Faces.AddFace(ind + 1, ind + 2, ind + 3);
      mesh_rec.Faces.AddFace(ind + 5, ind + 3, ind + 4);
    }
  }


  public Point3f middle(Point3f A, Point3f B)
  {
    Point3f AB = new Point3f();
    float length;
    AB.X = (A.X + B.X) / 2;
    AB.Y = (A.Y + B.Y) / 2;
    AB.Z = (A.Z + B.Z) / 2;

    length = (float) Math.Sqrt(AB.X * AB.X + AB.Y * AB.Y + AB.Z * AB.Z);
    AB.X = AB.X / length;
    AB.Y = AB.Y / length;
    AB.Z = AB.Z / length;
    return AB;
  }
# ---------- end c_script ----------
scale = Scale(Geometry=c_script.A, Center=Point(0, 0, 0), Factor=Slider(16, range=1..30))  # -> Geometry, Transform

# ---- group: Meshes / Sphere quad
msphereex = MeshSphereEx(Base=PlaneXY(0, 0, 0), Radius=Slider(30, range=1..30), Count=10)

# ---- group: Meshes / Square
number_slider_5 = Slider(20, range=5..100)
rec = Rectangle({Plane=PlaneXY(-40, -40, 0), Size=Domain2(u=0..80, v=0..80)})
mplane = MeshPlane(Boundary=rec, WidthCount=number_slider_5, HeightCount=number_slider_5)  # -> Mesh, Area
move = Move(Geometry=mplane.Mesh, Motion="0,0,0")  # -> Geometry, Transform
xy = XYPlane(Origin=Point(0, 0, 0))
rotate = Rotate(Geometry=move.Geometry, Angle=degrees(Slider(0, range=0..360)), Plane=xy)  # -> Geometry, Transform

# ---- group: Meshes / Catadioptre
mesh = Mesh(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)
weldvertices = MeshWeldVertices(Mesh=mesh, Tolerance=0.01)  # -> RuntimeMessage, Mesh
unifynormals = MeshUnifyNormals(Mesh=weldvertices.Mesh)
wbcatmullclark = WeaverbirdsCatmullClarkSubdivision(MeshCurves=unifynormals, Level=2, SmoothNakedEdges=1)
flip = MeshFlip(Mesh=wbcatmullclark)

# ---- group: Meshes / Torus
mesh_2 = Mesh(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)

# ---- group: Direction
demesh = DeconstructMesh(Mesh=rotate.Geometry)  # -> Vertices, Faces, Colours, Normals
pdecon = Deconstruct(Point=demesh.Vertices)  # -> XComponent, YComponent, ZComponent
panel = Panel("""{1,0,0}
{1,0,0]""")
expression = Expression(x=pdecon.XComponent, Expression="if(x<0,0,1)")
item = ListItem(List=panel, Index=expression, Wrap=True)

# ----
filter = StreamFilter(Gate=list, Stream0=rotate.Geometry, Stream1=flip, Stream2=msphereex, Stream3=scale.Geometry, Stream4=mesh_2)
X = UnitX(Factor=1)
filter_2 = StreamFilter(Gate=list, Stream0=item, Stream1=X, Stream2=X, Stream3=X, Stream4=X)
c_script_2 = CSharpScript(
    mesh=filter,
    seed=Slider(251, range=0..500),
    dirAtPoint=filter_2,
    directionality=number_slider,
    numberOfDirections=number_slider_2,
    driverType=list_2,
    RelativeWallThickness=number_slider_4,
    WallHeight=number_slider_3,
    OutputMesh=toggle,
    TooltipDescriptionOverride="V2.0 Laurent Delrieu l.delrieu@neuf.fr Add directonality, normals",
    TooltipTextOverride="Maze with mesh, recursive backtracker")  # -> out, Walls, Pw, LPw, PPw, Normalsw, Path, Pp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; inputs mesh: Mesh, seed: Int32, dirAtPoint: list of Vector3d, directionality: Double, numberOfDirections: Int32, driverType: Int32, RelativeWallThickness: Double, WallHeight: Double, OutputMesh: Boolean
# ---------- c_script_2: C# ----------
    //Perfect maze on mesh using recursive backtracer
    //Laurent Delrieu
    //L.delrieu@neuf.fr
    //V2 : 20 of may 2016
    //References
    //  http://www.astrolog.org/labyrnth/algrithm.htm
    //  http://www.jamisbuck.org/mazes/
    //  http://elfnor.com/maze-any-mesh-in-blender.html
    //  http://www.grasshopper3d.com/forum/topics/wip-maze-definition
    //TODO
    // NGON mesh using Turtle, Plankton or new rhino 6 mesh
    // New strategy to change texture of maze, for example turn left...


    //INPUTS
    //
    if (mesh.FaceNormals.Count < mesh.Faces.Count)
    {
      mesh.FaceNormals.ComputeFaceNormals();
      this.Component.AddRuntimeMessage(GH_RuntimeMessageLevel.Remark, "Faces normals calculation for the mesh");
      if (mesh.FaceNormals.Count < mesh.Faces.Count)
      {
        this.Component.AddRuntimeMessage(GH_RuntimeMessageLevel.Error, "Not possible to calculate faces normals of this mesh");
      }
    }

    //Propose a default values list
    if (Component.Params.Input[5].SourceCount == 0)
    {
      InputTools.DriversList(ref Component, ref GrasshopperDocument, 5, 11);
    }
    ////////////////////////
    //Test for direction at each point/vertice of the mesh
    if (dirAtPoint.Count <= 0)
    {
      this.Component.AddRuntimeMessage(GH_RuntimeMessageLevel.Remark, "No directions provided, vector X is put by default");
      for (int i = 0;i < mesh.Vertices.Count; i++) dirAtPoint.Add(Vector3d.XAxis);
    }
    else
    {
      if (dirAtPoint.Count < mesh.Vertices.Count)
      {
        this.Component.AddRuntimeMessage(GH_RuntimeMessageLevel.Remark, "There must be the same number of direction and vertices of the mesh");
        this.Component.AddRuntimeMessage(GH_RuntimeMessageLevel.Remark, "Last direction provided is used as default for mission direction");
        int n = dirAtPoint.Count - 1;
        for (int i = (dirAtPoint.Count);i < mesh.Vertices.Count; i++) dirAtPoint.Add(dirAtPoint[n]);
      }
    }
    for (int i = 0;i < dirAtPoint.Count; i++)
    {
      if  (!dirAtPoint[i].Unitize()) dirAtPoint[i] = Vector3d.XAxis;
    }
    //////////////////////////////
    //Directionality
    // if 0 => no directionality => random
    // if 1 => full directionality
    if (directionality < 0.0)
    {
      this.Component.AddRuntimeMessage(GH_RuntimeMessageLevel.Remark, "Directionality mut be bigger or equal to 0 and lesser or equal to 1");
      directionality = 0.0;
    }
    else
    {
      if (directionality > 1.0)
      {
        this.Component.AddRuntimeMessage(GH_RuntimeMessageLevel.Remark, "Directionality mut be bigger or equal to 0 and lesser or equal to 1");
        directionality = 1.0;
      }
    }
    //This parameter is used to indicate how many  directions of the path we store
    if (numberOfDirections < 0)
    {
      numberOfDirections = 0;
    }

    Random rnd = new Random(seed);
    //We choose a driver on the mesh
    LDDriver driver;
    switch (driverType)
    {
      case 0:
        driver = new  LDDriverRandom(mesh, dirAtPoint, rnd);
        break;
      case 1:
        driver = new  LDDriverDirection(mesh, dirAtPoint, rnd, directionality, numberOfDirections);
        break;
      case 2:
        driver = new  LDDriverTurn(mesh, dirAtPoint, rnd, directionality, numberOfDirections);
        break;
      case 3:
        driver = new  LDDriverZigZag(mesh, dirAtPoint, rnd);
        break;
      default:
        driver = new  LDDriverRandom(mesh, dirAtPoint, rnd);
        break;
    }



    //End test for inputs

    // List to know which faces were visited
    //Indice is the face number
    List<bool> visited_faces = new  List<bool>();
    for (int i = 0; i < mesh.Faces.Count; i++)
    {
      visited_faces.Add(false);
    }

    // List to know which edges were visited
    //Border edges could not be visited so they are considered visited
    //Indice is the edge number
    List<bool> visited_edges = new  List<bool>();
    for (int i = 0; i < mesh.TopologyEdges.Count; i++)
    {
      int[] connectedFaces = mesh.TopologyEdges.GetConnectedFaces(i);
      if (connectedFaces.Length == 2) visited_edges.Add(false);
      else visited_edges.Add(false);
    }

    //List to maintain faces that were made
    List<LDFace> faces = new List<LDFace>();

    //We choose a random face
    int rand_face = rnd.Next(mesh.Faces.Count);

    //We choose a random edge
    int[] allEdges = mesh.TopologyEdges.GetEdgesForFace(rand_face);
    List<int> possibleEdges = new List<int>();
    for (int i = 0; i < allEdges.Length; i++)
    {
      int[] face_in_contact = mesh.TopologyEdges.GetConnectedFaces(allEdges[i]);
      if (face_in_contact.Length == 2) possibleEdges.Add(allEdges[i]);
    }
    //First face
    LDFace current_face = new LDFace(mesh, rand_face, -1, null, ref visited_edges, ref visited_faces);

    do
    {
      //Abort if escape pressed
      if (GH_Document.IsEscapeKeyDown()) GrasshopperDocument.RequestAbortSolution();

      //We add the current face to a list
      faces.Add(current_face);
      //Next face
      LDFace next_face = NextFace(current_face, mesh, ref visited_edges, ref visited_faces, driver);

      //If no next face we go back until we find one or we arrive at the beginning
      if (next_face == null)
      {
        current_face = Back(current_face, mesh, ref visited_edges, ref visited_faces);
      }
      else
      {
        current_face = next_face;
      }
    }
    while (current_face.faceFrom != null);       //Exit if we are at the beginning

    //Lines for drawing borders (excepts the edges)
    List<Line> lines = new List<Line>();
    for (int i = 0; i < mesh.TopologyEdges.Count; i++)
    {
      if (!visited_edges[i]) lines.Add(mesh.TopologyEdges.EdgeLine(i));
    }

    //OUTPUTS
    //WALLS
    Walls = lines;
    //TODO add connectivity  points, point-point ... normals
    
    //PATH
    Path = ToLines(faces);
    Pp = MeshCenters(mesh);

    DataTree<int> LinePoints = LDfaceToLinePoint(faces);
    LPp = LinePoints;

    DataTree<int> pointPoints = new DataTree<int>();
    for (int n_line = 0; n_line < LinePoints.BranchCount; n_line++)
    {
      pointPoints.Add(LinePoints.Branches[n_line][0], new GH_Path(LinePoints.Branches[n_line][1]));
      pointPoints.Add(LinePoints.Branches[n_line][1], new GH_Path(LinePoints.Branches[n_line][0]));
    }

    // PPp = LDfaceToPointPoints(faces);
    PPp = pointPoints;
    Normalsp = mesh.FaceNormals;
    Begin = new Point3d(FaceCenter(mesh, rand_face));

    
    if (OutputMesh)
    {
      Mesh MeshOut = new Mesh();
      foreach (var face in faces)
      {
        face.ToMesh(mesh, ref  MeshOut, WallHeight, RelativeWallThickness);
      }
      MeshOut.Normals.ComputeNormals();
      MeshOut.UnifyNormals();
      MeshOut.Compact();
      MeshOut.Unweld(1, true);
      MeshOut.Weld(1);

      MeshMaze = MeshOut;
    }
# ---------- c_script_2: C# additional code ----------
  //////////////////////////////////////////////
  //This class is used to "drive" "walk" on the mesh
  //It is coul be derived in many type of driving
  public abstract class LDDriver
  {
    public Mesh mesh;
    public List<Vector3d> directionsAtVertices;
    public Random rnd;

    public void init(Mesh _mesh, List<Vector3d> _directionsAtVertices, Random _rnd)
    {
      mesh = _mesh;
      directionsAtVertices = _directionsAtVertices;
      rnd = _rnd;
    }
    public abstract int Next(LDFace faceFrom, List<int> possibleEdges, List<int> possibleFaces);
    public abstract void Reset();
  }

  /////////////////////////
  //Random driver
  public class LDDriverRandom : LDDriver
  {
    public LDDriverRandom(Mesh _mesh, List<Vector3d> _directionsAtVertices, Random _rnd)
    {
      init(_mesh, _directionsAtVertices, _rnd);
    }
    public override  int Next(LDFace faceFrom, List<int> possibleEdges, List<int> possibleFaces)
    {
      return  rnd.Next(possibleFaces.Count);
    }
    public override void Reset()
    {}
  }
  /////////////////////////
  //Directional driver
  public class LDDriverDirection : LDDriver
  {
    //A coefficient
    //if 0 no directionality, random
    //If 1 full directionality, almost no random
    double directionality;
    int NumberOfDirectionStored;
    Rhino.Geometry.Collections.MeshTopologyVertexList vertexTop;
    List<Vector3d> directions;

    public LDDriverDirection(Mesh _mesh, List<Vector3d> _directionsAtVertices, Random _rnd, double _directionality, int _numberOfDirectionStored)
    {
      directionality = _directionality;
      init(_mesh, _directionsAtVertices, _rnd);
      vertexTop = mesh.TopologyVertices;
      directions = new List<Vector3d>();
      NumberOfDirectionStored = _numberOfDirectionStored;
    }

    public override void Reset()
    {
      directions.Clear();
    }

    public override  int Next(LDFace faceFrom, List<int> possibleEdges, List<int> possibleFaces)
    {
      double rnd_double = rnd.NextDouble();
      if (rnd_double > directionality)
      {
        return  rnd.Next(possibleFaces.Count);
      }
      else
      {
        double test = 0.0;
        int indice = 0;
        Vector3d directionBuffer = new Vector3d(0, 0, 0);

        //We seek for all the edges the edge that allow to follow the best the direction
        for (int i = 0; i < possibleEdges.Count;i++)
        {
          //Calculation of mean direction since XX movements
          //Direction from the current face to the new one
          Vector3d direction = FaceCenter(mesh, possibleFaces[i]) - FaceCenter(mesh, faceFrom.faceNumberOnMesh);
          direction.Unitize();
          Vector3d sumOfDirection = new Vector3d(direction);
          for (int j = 0; j < directions.Count; j++)
          {
            sumOfDirection = sumOfDirection + directions[j];
          }
          sumOfDirection.Unitize();

          //Direction to follow
          IndexPair indexPairOfEdge = mesh.TopologyEdges.GetTopologyVertices(possibleEdges[i]);
          int point1 = vertexTop.MeshVertexIndices(indexPairOfEdge.I)[0];
          int point2 = vertexTop.MeshVertexIndices(indexPairOfEdge.J)[0];


          Vector3d directionToFollow = directionsAtVertices[point1] + directionsAtVertices[point2];
          directionToFollow.Unitize();

          Vector3d v1 = Vector3d.CrossProduct(directionToFollow, sumOfDirection);

          double sinusAngle = Math.Abs(v1 * mesh.FaceNormals[possibleFaces[i]]);
          if (sinusAngle > test)
          {
            directionBuffer = new Vector3d(direction);
            test = sinusAngle;
            indice = i;
          }
        }
        directions.Add(directionBuffer);
        if (directions.Count > NumberOfDirectionStored) directions.RemoveAt(0);
        return indice;
      }
    }
  }
  /////////////////////////
  //Directional driver
  public class LDDriverTurn : LDDriver
  {
    Rhino.Geometry.Collections.MeshTopologyVertexList vertexTop;

    double directionality;
    List<Vector3d> directions;
    int numberOfDirections;
    double sens;

    public LDDriverTurn(Mesh _mesh, List<Vector3d> _directionsAtVertices, Random _rnd, double _directionality, int _numberOfDirections)
    {
      directionality = _directionality;
      init(_mesh, _directionsAtVertices, _rnd);
      vertexTop = mesh.TopologyVertices;
      directions = new List<Vector3d>();
      numberOfDirections = _numberOfDirections;
      sens = 1;
    }

    public override void Reset()
    {
      directions.Clear();
    }

    public override  int Next(LDFace faceFrom, List<int> possibleEdges, List<int> possibleFaces)
    {
      double rnd_double = rnd.NextDouble();
      if (rnd_double > directionality)
      {
        return  rnd.Next(possibleFaces.Count);
      }
      else
      {
        double test = 100000.0;
        int indice = 0;
        Vector3d directionBuffer = new Vector3d(0, 0, 0);


        if (directions.Count > numberOfDirections)
        {directions.Clear();
          sens = sens * -1;
        }

        for (int i = 0; i < possibleEdges.Count;i++)
        {
          Vector3d direction = FaceCenter(mesh, possibleFaces[i]) - FaceCenter(mesh, faceFrom.faceNumberOnMesh);
          direction.Unitize();
          Vector3d sumOfDirection = new Vector3d(direction);
          for (int j = 0; j < directions.Count; j++)
          {
            sumOfDirection = sumOfDirection + directions[j];
          }

          if (sens * sumOfDirection.Length < sens * test)
          {
            directionBuffer = new Vector3d(direction);
            test = sumOfDirection.Length;
            indice = i;
          }
        }
        directions.Add(directionBuffer);
        return indice;
      }
    }
  }
  /////////////////////////
  //Random driver
  public class LDDriverZigZag : LDDriver
  {
    int last;
    public LDDriverZigZag(Mesh _mesh, List<Vector3d> _directionsAtVertices, Random _rnd)
    {
      init(_mesh, _directionsAtVertices, _rnd);
      last = -1;
    }

    public override  int Next(LDFace faceFrom, List<int> possibleEdges, List<int> possibleFaces)
    {
      if (last < 0)
      {
        last = 1;
        return  (possibleFaces.Count - 1);
      }
      else
      {
        last = -1;
        return 0;
      }
    }
    public override void Reset()
    {

    }
  }
  //////////////////////////////////////////////
  public class LDFace
  {
    public int faceNumberOnMesh;
    public Point3d center;
    public List<LDFace> facesTo;
    public LDFace faceFrom;

    public void SetFace(LDFace face)
    {
      facesTo.Add(face);
    }

    public LDFace(Mesh m, int face, int edge, LDFace face_from, ref List<bool> visited_edges, ref List<bool> visited_faces)
    {
      faceNumberOnMesh = face;
      faceFrom = face_from;
      if (faceFrom != null)
      {
        faceFrom.SetFace(this);
      }

      facesTo = new List<LDFace>();
      center = new Point3d(FaceCenter(m, face));
      if (edge >= 0) visited_edges[edge] = true;
      visited_faces[face] = true;
    }

    public void ToMesh(Mesh meshFrom, ref Mesh meshTo, double height, double relative)
    {
      //For all edges
      int [] edgesForFace = meshFrom.TopologyEdges.GetEdgesForFace(this.faceNumberOnMesh);

      for (int i_edge = 0; i_edge < edgesForFace.Length; i_edge++)
      {
        bool edgeClosed = true;
        int edge = edgesForFace[i_edge];
        int[] face_in_contact = meshFrom.TopologyEdges.GetConnectedFaces(edge);

        if (faceFrom != null)
        {
          if (System.Array.IndexOf(face_in_contact, faceFrom.faceNumberOnMesh) > -1) edgeClosed = false;
        }

        // foreach (var face in  this.facesTo)
        for (int i = 0; i < facesTo.Count; i++)
        {
          //if (System.Array.IndexOf(face_in_contact, face.faceNumberOnMesh) > -1) edgeClosed = false;
          if (System.Array.IndexOf(face_in_contact, facesTo[i].faceNumberOnMesh) > -1) edgeClosed = false;
        }

        if (edgeClosed)
        {
          MeshOnEdgeNotClosed(meshFrom, ref meshTo, height, relative, edge, center);
        }
        else
        {
          MeshOnEdgeClosed(meshFrom, ref meshTo, height, relative, edge, center);
        }
      }
    }
  }
  //////////////////////////////////////////////
  static public void MeshOnEdgeClosed(Mesh meshFrom, ref Mesh meshTo, double height, double relative, int i_edge, Point3d center)
  {
    IndexPair indexPair = meshFrom.TopologyEdges.GetTopologyVertices(i_edge);
    Point3d p1 = meshFrom.TopologyVertices[indexPair.I];
    Point3d p2 = meshFrom.TopologyVertices[indexPair.J];
    Vector3d v1 = meshFrom.Normals[meshFrom.TopologyVertices.MeshVertexIndices(indexPair.I)[0]];
    v1.Unitize();
    v1 = v1 * height;
    Vector3d v2 = meshFrom.Normals[meshFrom.TopologyVertices.MeshVertexIndices(indexPair.J)[0]];
    v2.Unitize();
    v2 = v2 * height;

    Vector3d v12 = (p2 - p1) * relative / 2;
    Vector3d v1centre = (center - p1) * relative;
    Vector3d v2centre = (center - p2) * relative;


    Rhino.Geometry.Mesh mesh = new Rhino.Geometry.Mesh();
    mesh.Vertices.Add(center); //0
    mesh.Vertices.Add(p1 + v1centre); //1
    mesh.Vertices.Add(p1); //2
    mesh.Vertices.Add(p1 + v12); //3
    mesh.Vertices.Add((p1 + p2) / 2); //4
    mesh.Vertices.Add(p2 - v12); //5
    mesh.Vertices.Add(p2); //6
    mesh.Vertices.Add(p2 + v2centre); //7
    mesh.Vertices.Add(p1 + v1centre + v1); //8
    mesh.Vertices.Add(p1 + v1); //9
    mesh.Vertices.Add(p1 + v12 + v1); //10
    mesh.Vertices.Add(p2 - v12 + v2); //11
    mesh.Vertices.Add(p2 + v2); //12
    mesh.Vertices.Add(p2 + v2centre + v2); //13

    mesh.Faces.AddFace(0, 4, 3, 1);
    mesh.Faces.AddFace(1, 3, 10, 8);
    mesh.Faces.AddFace(8, 10, 9);
    mesh.Faces.AddFace(0, 7, 5, 4);
    mesh.Faces.AddFace(5, 7, 13, 11);
    mesh.Faces.AddFace(13, 12, 11);

    meshTo.Append(mesh);

  }

  //////////////////////////////////////////////
  static public void MeshOnEdgeNotClosed(Mesh meshFrom, ref Mesh meshTo, double height, double relative, int i_edge, Point3d center)
  {
    IndexPair indexPair = meshFrom.TopologyEdges.GetTopologyVertices(i_edge);
    Point3d p1 = meshFrom.TopologyVertices[indexPair.I];
    Point3d p2 = meshFrom.TopologyVertices[indexPair.J];
    Vector3d v1 = meshFrom.Normals[meshFrom.TopologyVertices.MeshVertexIndices(indexPair.I)[0]];
    v1.Unitize();
    v1 = v1 * height;
    Vector3d v2 = meshFrom.Normals[meshFrom.TopologyVertices.MeshVertexIndices(indexPair.J)[0]];
    v2.Unitize();
    v2 = v2 * height;

    Vector3d v12 = (p2 - p1) * relative / 2;
    Vector3d v1centre = (center - p1) * relative;
    Vector3d v2centre = (center - p2) * relative;
    Vector3d vmidcentre = (center - (p1 + p2) / 2) * relative;

    Rhino.Geometry.Mesh mesh = new Rhino.Geometry.Mesh();
    mesh.Vertices.Add(center); //0
    mesh.Vertices.Add(p1 + v1centre); //1
    mesh.Vertices.Add(p1 + v1centre + v1); //2
    mesh.Vertices.Add(p1 + v1); //3
    mesh.Vertices.Add(p1 + v1 + v12); //4
    mesh.Vertices.Add((p1 + p2) / 2 + (v1 + v2) / 2); //5
    mesh.Vertices.Add(p2 + v2 - v12); //6
    mesh.Vertices.Add(p2 + v2); //7
    mesh.Vertices.Add(p2 + v2 + v2centre); //8
    mesh.Vertices.Add((p1 + v1centre + v1 + p2 + v2 + v2centre) / 2); //9
    mesh.Vertices.Add(p2 + v2centre); //10
    mesh.Vertices.Add((p1 + v1centre + p2 + v2centre) / 2); //11
    mesh.Faces.AddFace(0, 11, 1);
    mesh.Faces.AddFace(11, 9, 2, 1);
    mesh.Faces.AddFace(2, 4, 3);
    mesh.Faces.AddFace(5, 4, 2, 9);
    mesh.Faces.AddFace(5, 9, 8, 6);
    mesh.Faces.AddFace(6, 8, 7);
    mesh.Faces.AddFace(8, 9, 11, 10);
    mesh.Faces.AddFace(0, 10, 11);
    meshTo.Append(mesh);

  }
  /////////////////////
  public static LDFace NextFace(LDFace face_from, Mesh m, ref List<bool> visited_edges, ref List<bool> visited_faces, LDDriver driver)
  {
    List<int> possibleEdges = new List<int>();
    List<int> possibleFaces = new List<int>();
    int edge;
    int face;
    //All edges around the current face
    int[] allEdges = m.TopologyEdges.GetEdgesForFace(face_from.faceNumberOnMesh);

    for (int i = 0; i < allEdges.Length; i++)
    {
      edge = allEdges[i];
      int[] face_in_contact = m.TopologyEdges.GetConnectedFaces(edge);
      //If edge is not a border
      if (face_in_contact.Length == 2)
      {
        if (face_in_contact[0] == face_from.faceNumberOnMesh) face = face_in_contact[1];
        else face = face_in_contact[0];

        if (!visited_edges[edge] && !visited_faces[face])
        {
          possibleEdges.Add(edge);
          possibleFaces.Add(face);
        }
      }
    }

    LDFace next_face = null;
    if (possibleEdges.Count > 0)
    {
      //Random choice
      int rand_index = driver.Next(face_from, possibleEdges, possibleFaces);
      next_face = new LDFace(m, possibleFaces[rand_index], possibleEdges[rand_index], face_from, ref visited_edges, ref visited_faces);
    }
    else
    {
      driver.Reset();
    }
    return next_face;
  }


  //////////////////////////////////////////////
  public static LDFace Back(LDFace face_end, Mesh m, ref List<bool> visited_edges, ref List<bool> visited_faces)
  {
    LDFace face = face_end;
    bool asFreeEdge = false;

    do
    {
      face = face.faceFrom;
      int[] allEdges = m.TopologyEdges.GetEdgesForFace(face.faceNumberOnMesh);
      asFreeEdge = false;
      for (int i = 0; i < allEdges.Length; i++)
      {
        if (visited_edges[allEdges[i]] == false)
        {
          asFreeEdge = true;
        }
      }
    }
    while ((face.faceFrom != null) && !asFreeEdge);

    return face;
  }
  ///////////////////////////////////////////////
  public List<Line> ToLines(List<LDFace> faces)
  {
    List<Line> lines = new  List<Line>();
    for (int i = 0; i < faces.Count; i++)
    {
      if (faces[i].faceFrom != null) lines.Add(new Line(faces[i].center, faces[i].faceFrom.center));
    }
    return lines;
  }

  ///////////////////////////////////////////////
  public List<Point3d> MeshCenters(Mesh mesh)
  {
    List<Point3d> P = new  List<Point3d>();
    for (int i = 0; i < mesh.Faces.Count; i++)
    {
      P.Add(FaceCenter(mesh, i));

      //if (faces[i].faceFrom != null) lines.Add(new Line(faces[i].center, faces[i].faceFrom.center));
    }
    return P;
  }



  public  DataTree<int> LDfaceToLinePoint(List<LDFace> faces)
  {
    DataTree<int> LinePoint = new DataTree<int>();
    int index = 0;
    for (int i = 0; i < faces.Count; i++)
    {
      if (faces[i].faceFrom != null)
      {
        LinePoint.Add(faces[i].faceNumberOnMesh, new GH_Path(index));
        LinePoint.Add(faces[i].faceFrom.faceNumberOnMesh, new GH_Path(index));
        index += 1;
      }
    }
    return LinePoint;
  }
  public  DataTree<int> LDfaceToPointPoints(List<LDFace> faces)
  {
    DataTree<int> PointPoints = new DataTree<int>();
    for (int i = 0; i < faces.Count; i++)
    {
      if (faces[i].faceFrom != null)
      {
        PointPoints.Add(faces[i].faceFrom.faceNumberOnMesh, new GH_Path(faces[i].faceNumberOnMesh));
      }
      for (int j = 0; j < faces[i].facesTo.Count;j++)
      {
        PointPoints.Add(faces[i].facesTo[j].faceNumberOnMesh, new GH_Path(faces[i].faceNumberOnMesh));
      }
    }
    return PointPoints;
  }


  ///////////////////////////////////////////
  //A utility to calculate the center of a face
  public static Point3d FaceCenter(Mesh mesh, int face)
  {
    Point3d pt = new Point3d(0, 0, 0);
    pt = pt + mesh.Vertices[mesh.Faces[face].A] + mesh.Vertices[mesh.Faces[face].B] + mesh.Vertices[mesh.Faces[face].C];
    if (mesh.Faces[face].IsQuad)
    {
      pt = pt + mesh.Vertices[mesh.Faces[face].D];
      pt = pt / 4.0;
    }
    else
    {
      pt = pt / 3.0;
    }
    return pt;
  }

  //Copy from Aidan Kurtz Intralattice on Github
  //https://github.com/dnkrtz
  public class InputTools
  {
    /// <summary>
    /// Generates selection list for preset drivers on mesh
    /// </summary>
    /// <param name="index">Component input index. (first input is index 0)</param>
    /// <param name="offset">Vertical offset of the menu, to help with positioning.</param>
    public static void DriversList(ref IGH_Component Component, ref GH_Document GrasshopperDocument, int index, float offset)
    {
      // Instantiate  new value list
      var vallist = new Grasshopper.Kernel.Special.GH_ValueList();
      vallist.ListMode = Grasshopper.Kernel.Special.GH_ValueListMode.DropDown;
      vallist.CreateAttributes();

      // Customise value list position
      float xCoord = (float) Component.Attributes.Pivot.X - 300;
      float yCoord = (float) Component.Attributes.Pivot.Y + index * 20 - offset;
      PointF cornerPt = new PointF(xCoord, yCoord);
      vallist.Attributes.Pivot = cornerPt;

      // Populate value list with our own data
      vallist.ListItems.Clear();
      var items = new List<Grasshopper.Kernel.Special.GH_ValueListItem>();
      items.Add(new Grasshopper.Kernel.Special.GH_ValueListItem("Random Maze", "0"));
      items.Add(new Grasshopper.Kernel.Special.GH_ValueListItem("Directional Maze", "1"));
      items.Add(new Grasshopper.Kernel.Special.GH_ValueListItem("Try to come back Maze", "2"));
      items.Add(new Grasshopper.Kernel.Special.GH_ValueListItem("Zig Zag", "3"));

      vallist.ListItems.AddRange(items);

      // Until now, the slider is a hypothetical object.
      // This command makes it 'real' and adds it to the canvas.
      GrasshopperDocument.AddObject(vallist, false);

      //Connect the new slider to this component
      Component.Params.Input[index].AddSource(vallist);
      Component.Params.Input[index].CollectData();
    }
  }
# ---------- end c_script_2 ----------
xz = XZPlane(Origin=Point(0, 0, 0))
int = Integer(2)
c_script_3 = CSharpScript()  # -> Out, A
filter_3 = StreamFilter(Gate=toggle, Stream0=c_script_2.Walls, Stream1=c_script_2.MeshMaze)
swatch = ColourSwatch(SwatchColor=RGB(0, 17, 255))
filter_4 = StreamFilter(Gate=toggle, Stream0=c_script_2.Path, Stream1=c_script_2.MeshMaze)
pt = Point(c_script_2.Begin)
swatch_2 = ColourSwatch(SwatchColor=RGB(255, 0, 0))
mesh_3 = Mesh(filter_4)

pt_2 = Point([Point(0, 10, 0), Point(10, 10, 0), Point(10, -10, 0), Point(0, -10, 0)])
pdecon_2 = Deconstruct(Point=pt_2)  # -> XComponent, YComponent, ZComponent
c_script_4 = CSharpScript(
    P=c_script_2.Pp,
    LP=c_script_2.LPp,
    PP=c_script_2.PPp,
    NormalsAtPoint=c_script_2.Normalsp,
    HeightsAtPoint=Slider(2.7, range=0.1..20),
    NumberOfSections=Slider(3, range=1..8),
    Striction=Slider(1.2, range=-2..2),
    LateralCoordinates=pdecon_2.XComponent,
    HeightCoordinates=pdecon_2.YComponent,
    TooltipDescriptionOverride="V1.2 Laurent Delrieu l.delrieu@neuf.fr",
    TooltipTextOverride="Thicken a network of lines with specified half section")  # -> out, M; inputs P: list of Point3d, LP: tree of Int32, PP: tree of Int32, NormalsAtPoint: list of Vector3d, HeightsAtPoint: list of Double, NumberOfSections: Int32, Striction: Double, LateralCoordinates: list of Double, HeightCoordinates: list of Double
# ---------- c_script_4: C# ----------
    //Parameters that could be used
    bool zbool = true;
    double angle = Math.PI;
    double deviation = 0.0;
    int n_v = 2;

    List<Point3d> points = new List<Point3d>(P);
    DataTree<int> lineVertex = new DataTree<int>(LP);
    DataTree<int> vertexVertexes = new DataTree<int>(PP);
    List<LDPanel> panels = new List<LDPanel>();
    double width_calc = 0.0;
    bool isEnd;
    List<Line> linesOut = new List<Line>();
    DataTree<Line> linesBranch = new DataTree<Line>();
    List<Line> linesEnd = new List<Line>();

    //Widths at point
    //If none width => error message
    //If one width, it is replicated to all points
    //If not enough the last width is used to fill the list
    if (HeightsAtPoint.Count < 1)
    {
      this.Component.AddRuntimeMessage(GH_RuntimeMessageLevel.Error, "You must provide at minimum one height");
      return;
    }
    if (HeightsAtPoint.Count < points.Count)
    {
      int last = HeightsAtPoint.Count - 1;
      for (int i = HeightsAtPoint.Count; i <= (points.Count - 1); i++)
      {
        HeightsAtPoint.Add(HeightsAtPoint[last]);
      }
    }
    List<double> width_b = new List<Double>();
    List<double> width_e = new List<Double>();
    for (int i = 0; i < lineVertex.BranchCount; i++)
    {
      width_b.Add(HeightsAtPoint[lineVertex.Branch(i)[0]]);
      width_e.Add(HeightsAtPoint[lineVertex.Branch(i)[1]]);
    }

    //Normal on point
    //If none calculation of mean normal
    //If one normal, it is replicated to all points
    //If not enough the last normal is used to fill the list
    if (NormalsAtPoint.Count < 1)
    {
      this.Component.AddRuntimeMessage(GH_RuntimeMessageLevel.Remark, "No normal provided, normal calculated with mean plane through points");
      Plane plane;
      PlaneFitResult planeFitResult = Plane.FitPlaneToPoints(points, out  plane);
      if (planeFitResult == PlaneFitResult.Failure)
      {
        NormalsAtPoint.Add(Vector3d.ZAxis);
      }
      else
      {
        NormalsAtPoint.Add(plane.Normal);
      }
    }
    if (NormalsAtPoint.Count < points.Count)
    {
      int last = NormalsAtPoint.Count - 1;
      for (int i = NormalsAtPoint.Count; i <= (points.Count - 1); i++)
      {
        NormalsAtPoint.Add(NormalsAtPoint[last]);
      }
    }
    List<Vector3d> normal_begin = new List<Vector3d>();
    List<Vector3d> normal_end = new List<Vector3d>();
    for (int i = 0; i < lineVertex.BranchCount; i++)
    {
      normal_begin.Add(NormalsAtPoint[lineVertex.Branch(i)[0]]);
      normal_end.Add(NormalsAtPoint[lineVertex.Branch(i)[1]]);
    }
    ///End Normal on point


    if (NumberOfSections < 2)
    {
      this.Component.AddRuntimeMessage(GH_RuntimeMessageLevel.Remark, "No or not enough NumberOfSections, default = 2");
      NumberOfSections = 2;
    }

    if (Striction <= -3) Striction = -3;
    if (Striction >= 3) Striction = 3;

    if ((LateralCoordinates.Count < 2) || (HeightCoordinates.Count < 2) || (LateralCoordinates.Count != HeightCoordinates.Count))
    {
      this.Component.AddRuntimeMessage(GH_RuntimeMessageLevel.Remark, "No points for sections provided, by default an arc is created with 6 points");
    }
    Section sectionCurve = new Section(LateralCoordinates, HeightCoordinates);

    //For all lines
    //Get median lines at intersection of paths
    for (int i = 0; i < lineVertex.BranchCount; i++)
    {
      Line lineOut = new Line();
      LDSide side1 = new LDSide();
      LDSide side2 = new LDSide();

      //One side of the line
      lineOut = LinePerp(points, lineVertex, vertexVertexes, true, true, i, width_b, width_e, out isEnd, out width_calc, normal_begin, normal_end);
      if (isEnd) linesEnd.Add(lineOut);
      linesBranch.Add(lineOut, new GH_Path(i * 2));
      side1 = new LDSide(lineVertex.Branch(i)[1], points[lineVertex.Branch(i)[1]], lineOut.Direction, isEnd, width_calc, normal_end[i]);

      lineOut = LinePerp(points, lineVertex, vertexVertexes, false, false, i, width_b, width_e, out isEnd, out width_calc, normal_begin, normal_end);
      if (isEnd) linesEnd.Add(lineOut);
      linesBranch.Add(lineOut, new GH_Path(i * 2));
      side2 = new LDSide(lineVertex.Branch(i)[0], points[lineVertex.Branch(i)[0]], lineOut.Direction, isEnd, width_calc, normal_begin[i]);
      panels.Add(new LDPanel(side1, side2, i));

      //Other side of the line
      lineOut = LinePerp(points, lineVertex, vertexVertexes, false, true, i, width_b, width_e, out isEnd, out width_calc, normal_begin, normal_end);
      if (isEnd) linesEnd.Add(lineOut);
      linesBranch.Add(lineOut, new GH_Path(i * 2 + 1));
      side1 = new LDSide(lineVertex.Branch(i)[0], points[lineVertex.Branch(i)[0]], lineOut.Direction, isEnd, width_calc, normal_begin[i]);

      lineOut = LinePerp(points, lineVertex, vertexVertexes, true, false, i, width_b, width_e, out isEnd, out width_calc, normal_begin, normal_end);
      if (isEnd) linesEnd.Add(lineOut);
      linesBranch.Add(lineOut, new GH_Path(i * 2 + 1));
      side2 = new LDSide(lineVertex.Branch(i)[1], points[lineVertex.Branch(i)[1]], lineOut.Direction, isEnd, width_calc, normal_end[i]);
      panels.Add(new LDPanel(side1, side2, i));
    }

    DataTree<LDPanel> treePanels = new DataTree<LDPanel>();
    DataTree<int> treeInt = new DataTree<int>();

    int test = 0;
    int branch = 0;
    while (panels.Count > 0)
    {
      treePanels.Add(panels[0], new GH_Path(branch));
      treeInt.Add(panels[0].lineNumber, new GH_Path(branch));
      panels.RemoveAt(0);

      int intersections = 0;
      do
      {
        List<LDPanel> intPanels = GetIntersections(treePanels.Branch(branch), panels);
        intersections = intPanels.Count;
        for (int i = (intPanels.Count - 1); i >= 0; i--)
        {
          treePanels.Add(intPanels[i], new GH_Path(branch));
          treeInt.Add(intPanels[i].lineNumber, new GH_Path(branch));
          panels.Remove(intPanels[i]);
        }
      } while (intersections > 0);
      test += 1;
      branch += 1;
    }
    /*DataTree<Brep> brepTree = new DataTree<Brep>();
    for (int i = 0; i < treePanels.BranchCount; i++)
    {
      for (int j = 0; j < treePanels.Branch(i).Count; j++)
      {
        brepTree.Add(treePanels.Branch(i)[j].ToBrep(), new GH_Path(i));
      }
    }*/

    DataTree<Mesh> meshTree = new DataTree<Mesh>();
    List<Point3d> fixedPoints = new List<Point3d>();
    DataTree<LineCurve> listUCurves = new DataTree<LineCurve> ();
    DataTree<LineCurve> listVCurves = new DataTree<LineCurve> ();
    for (int i = 0; i < treePanels.BranchCount; i++)
    {
      for (int j = 0; j < treePanels.Branch(i).Count; j++)
      {
        meshTree.Add(treePanels.Branch(i)[j].ToMesh(NumberOfSections, n_v, Math.Exp(Striction), angle, ref fixedPoints, ref listUCurves, ref  listVCurves, deviation, zbool, sectionCurve), new GH_Path(i));
      }
    }
    //lines = linesBranch;
    //ends = linesEnd;
    //connect = treeInt;
    //brep = brepTree;
    M = meshTree;
    // F = fixedPoints;
    // U = listUCurves;
    //  V = listVCurves;
# ---------- c_script_4: C# additional code ----------
  //For points begin and end, representing a line, search the width
  public double getWidthAtBeginning(int begin, int end, DataTree<int> lineVertex, List<double> w_b, List<double> w_e)
  {
    double output = w_b[0];

    for (int i = 0; i < lineVertex.BranchCount; i++)
    {
      if ((lineVertex.Branches[i][0] == begin) && (lineVertex.Branches[i][1] == end))
      {
        output = w_b[i];
        break;
      }
      if ((lineVertex.Branches[i][0] == end) && (lineVertex.Branches[i][1] == begin))
      {
        output = w_e[i];
        break;
      }
    }
    return output;
  }

  //Calculate on the line i, some curve perpandicular if it is an end or mediane if connection with other lines
  // bool one is used to know if we begin from the first point (beginning) of line or second (end)
  public Line LinePerp(List<Point3d> points, DataTree<int> lineVertex, DataTree<int> vertexVertexes, bool one, bool two, int i, List<double> width_b, List<double> width_e, out bool isEnd, out double width_calc, List<Vector3d> normal_begin, List<Vector3d> normal_end)
  {
    int i0, i1;
    double signe = 1.0;
    double width;
    Vector3d dirAtNode;
    if (one)
    {
      i0 = 0;
      i1 = 1;
      width = width_e[i];
      dirAtNode = normal_end[i];
    }
    else
    {
      i0 = 1;
      i1 = 0;
      width = width_b[i];
      dirAtNode = normal_begin[i];
    }

    if (two) signe = 1.0;
    else signe = -1.0;


    Vector3d dirPerp2 = new Vector3d();
    //Direction of the line
    Vector3d dirOfLine = (Vector3d) (points[lineVertex.Branch(i)[i1]] - points[lineVertex.Branch(i)[i0]]);
    Vector3d dirOfLine2 = new Vector3d();
    //One direction perpendicular of the line, depending on signe sign
    Vector3d dirPerp = Vector3d.CrossProduct(dirOfLine, signe * dirAtNode);
    dirPerp.Unitize();

    double angleTampon;
    double angle = 10.0;
    double width_buffer = width;
    angle = angle * signe;
    //More than one branch
    if (vertexVertexes.Branch(lineVertex.Branch(i)[i1]).Count > 1)
    {
      isEnd = false;
      //For all points connected to the points at the end of the line (end could be a beginning !)
      for (int j = 0; j < vertexVertexes.Branch(lineVertex.Branch(i)[i1]).Count; j++)
      {
        //If it is not the same line
        if (vertexVertexes.Branch(lineVertex.Branch(i)[i1])[j] != lineVertex.Branch(i)[i0])
        {
          Vector3d dir2 = (Vector3d) (points[vertexVertexes.Branch(lineVertex.Branch(i)[i1])[j]] - points[lineVertex.Branch(i)[i1]]);
          Vector3d dirPerp2Tampon = Vector3d.CrossProduct(dir2, signe * dirAtNode);
          dirPerp2Tampon.Unitize();

          //Line connected as 2 points :
          // vertexVertexes.Branch(lineVertex.Branch(i)[i1])[j]
          // lineVertex.Branch(i)[i1]
          angleTampon = Angle(dirPerp2Tampon, dirPerp, dirAtNode);

          if (signe * angleTampon < signe * angle)
          {
            angle = angleTampon;
            dirPerp2 = dirPerp2Tampon;
            dirOfLine2 = dir2;
            width_buffer = getWidthAtBeginning(lineVertex.Branch(i)[i1], vertexVertexes.Branch(lineVertex.Branch(i)[i1])[j], lineVertex, width_b, width_e);
          }
        }
      }
    }
      //Line as an End
    else
    {
      isEnd = true;
      angle = 0.0;
      dirPerp2 = dirPerp;
    }
    width = width + width_buffer;
    width = width / 2;
    width_calc = width;

    Vector3d newNormalAtPoint = Vector3d.CrossProduct(dirOfLine, dirOfLine2);
    if (newNormalAtPoint * dirAtNode < 0) newNormalAtPoint.Reverse();
    if (newNormalAtPoint.IsTiny()) newNormalAtPoint = dirAtNode;
    newNormalAtPoint.Unitize();
    Vector3d directionBetweenSection = dirPerp + dirPerp2;


    //If there is more than one line lied to the line
    //This allow a more smooth surface
    if (vertexVertexes.Branch(lineVertex.Branch(i)[i1]).Count > 2)
    {
    Vector3d test = Vector3d.CrossProduct(newNormalAtPoint, Vector3d.CrossProduct(directionBetweenSection, newNormalAtPoint));
    if (test.Length < 0.6)
    {
    //Component.AddRuntimeMessage(GH_RuntimeMessageLevel.Remark, "Passage dans la branche " + i);
    directionBetweenSection = test;
    }
    }

    if (width / (2.0 * Math.Cos(angle / 2) * Math.Cos(angle / 2)) > 100)
    {
      Component.AddRuntimeMessage(GH_RuntimeMessageLevel.Remark, "Pas de cosinus ");
      return new Line(points[lineVertex.Branch(i)[i1]], points[lineVertex.Branch(i)[i1]] - width * (directionBetweenSection));
    }
    else
    {
      return new Line(points[lineVertex.Branch(i)[i1]], points[lineVertex.Branch(i)[i1]] - width * (directionBetweenSection) / (2.0 * Math.Cos(angle / 2) * Math.Cos(angle / 2)));
    }
  }


  //This function replicate SandBox lines topology
  //As inputs there are lines
  //Tolerance is used to glued points thar are close to each others
  //Outputs are
  //points list of Point3d
  //linePoint dataTree containing the points index number for end and beginning of the line
  //pointPoint dataTree containing the points index number for each other point connected to this point
  public static void LineTopology(List < Line > lines, double tolerance, ref List<Point3d> points, ref DataTree<int> linePoint, ref DataTree<int> pointPoint, ref  DataTree<int> pointLine)
  {
    for (int n_line = 0; n_line < lines.Count; n_line++)
    {
      bool addPoint = true;
      int nPoint = 0;
      for (int i = 0; i < points.Count; i++)
      {
        if (points[i].DistanceTo(lines[n_line].From) < tolerance)
        {
          addPoint = false;
          nPoint = i;
        }
      }
      if (addPoint)
      {
        points.Add(lines[n_line].From);
        linePoint.Add(points.Count - 1, new GH_Path(n_line));
      }
      else
      {
        linePoint.Add(nPoint, new GH_Path(n_line));
      }

      addPoint = true;
      for (int i = 0; i < points.Count; i++)
      {
        if (points[i].DistanceTo(lines[n_line].To) < tolerance)
        {
          addPoint = false;
          nPoint = i;
        }
      }
      if (addPoint)
      {
        points.Add(lines[n_line].To);
        linePoint.Add(points.Count - 1, new GH_Path(n_line));
      }
      else
      {
        linePoint.Add(nPoint, new GH_Path(n_line));
      }
    }
    for (int n_line = 0; n_line < linePoint.BranchCount; n_line++)
    {
      pointPoint.Add(linePoint.Branches[n_line][0], new GH_Path(linePoint.Branches[n_line][1]));
      pointPoint.Add(linePoint.Branches[n_line][1], new GH_Path(linePoint.Branches[n_line][0]));
    }

    for (int j = 0; j < linePoint.BranchCount; j++)
    {
      pointLine.Add(j, new GH_Path(linePoint.Branch(j)[0]));
      pointLine.Add(j, new GH_Path(linePoint.Branch(j)[1]));
    }

  }
  ///End lineTopology

  public static double Angle(Vector3d v1, Vector3d v2, Vector3d dirPlane)
  {
    double output = -10;
    v1.Unitize();
    v2.Unitize();
    double g1 = Math.Acos(Math.Max(Math.Min(v1 * v2, 1.0), -1.0));
    double cross = Vector3d.CrossProduct(v1, v2) * dirPlane;
    double g2 = Math.Asin(Math.Max(Math.Min(cross, 1.0), -1.0));

    if (g2 >= 0)
    {
      output = g1;
    }

    else
    {
      if (g1 >= 0)
      {
        output = 2 * Math.PI - g1;
      }
      else
      {
        output = g2 + Math.PI;
      }
    }
    if (output > Math.PI) output = output - 2 * Math.PI;
    return (output % Math.PI);
  }
  ///////////////////////////
  public class LDPanel
  {
    public LDSide side1;
    public LDSide side2;
    public int lineNumber;

    public List<int> ToList()
    {
      List<int> output = new List<int>();
      output.Add(side1.nodeNumber);
      output.Add(side2.nodeNumber);
      output.Add(lineNumber);
      return output;
    }
    public Brep ToBrep()
    {
      List<Curve> curves = new List<Curve>();
      curves.Add(side1.ToCurve());
      curves.Add(side2.ToCurve());
      // Brep[] output = Brep.CreateFromLoft(curves, side1.point, side2.point, LoftType.Normal, false);
      Brep[] output = Brep.CreateFromLoft(curves, Point3d.Unset, Point3d.Unset, LoftType.Normal, false);

      if (output.Length > 0) return output[0];
      else return null;
    }

    //With DATATREE
    public Mesh ToMesh(int nu, int nv, double puissance, double angle, ref List<Point3d> fixedPoints, ref DataTree<LineCurve> listUCurves, ref DataTree<LineCurve> listVCurves, double deviation, bool zbool, Section sectionCurve)
    {
      List < Point3d > pts1 = new  List < Point3d >();
      List < Point3d > pts2 = new  List < Point3d >();

      Mesh mesh0 = new Mesh();
      Mesh endMesh1 = new Mesh();
      Mesh endMesh2 = new Mesh();

      if (side1.isEnd)
      {
        pts1 = EndSection(side1.point, new Vector3d(side2.point - side1.point), side1.direction, side1.normal, nv, angle, side1.width, zbool, sectionCurve);
        fixedPoints.AddRange(pts1);
        endMesh1 = QuarterRotation(pts1, side1.point, new Vector3d(side2.point - side1.point), side1.direction, side1.normal, 4);
      }
      else
      {
        pts1 = MiddleSection(side1.point, side1.direction, side1.normal, nv, angle, side1.width, zbool, sectionCurve);
      }

      if (side2.isEnd)
      {
        pts2 = EndSection(side2.point, new Vector3d(side1.point - side2.point), side2.direction, side2.normal, nv, angle, side2.width, zbool, sectionCurve);
        fixedPoints.AddRange(pts2);
        endMesh2 = QuarterRotation(pts2, side2.point, new Vector3d(side1.point - side2.point), side2.direction, side2.normal, 4);

      }
      else
      {
        pts2 = MiddleSection(side2.point, side2.direction, side2.normal, nv, angle, side2.width, zbool, sectionCurve);
      }

      mesh0 = PointsToMesh(pts1, pts2, nu, puissance, ref listUCurves, ref  listVCurves);
      mesh0.Append(endMesh1);
      mesh0.Append(endMesh2);
      mesh0.Vertices.CombineIdentical(true, true);
      return mesh0;
    }


    public LDPanel(LDSide s1, LDSide s2, int line)
    {
      side1 = s1;
      side2 = s2;
      lineNumber = line;
    }
    public bool Touch(LDPanel other)
    {
      bool output = false;
      Vector3d vect = new Vector3d();
      if (other.side1.nodeNumber == side1.nodeNumber)
      {
        vect = other.side1.direction - side1.direction;
        if (vect.Length < 0.001) output = true;
      }

      if (other.side2.nodeNumber == side1.nodeNumber)
      {
        vect = other.side2.direction - side1.direction;
        if (vect.Length < 0.001) output = true;
      }

      if (other.side1.nodeNumber == side2.nodeNumber)
      {
        vect = other.side1.direction - side2.direction;
        if (vect.Length < 0.001) output = true;
      }

      if (other.side2.nodeNumber == side2.nodeNumber)
      {
        vect = other.side2.direction - side2.direction;
        if (vect.Length < 0.001) output = true;
      }
      return output;
    }



  }
  public static  List<LDPanel> GetIntersections(List < LDPanel > lines, List<LDPanel> source)
  {
    List<LDPanel> output = new List<LDPanel>();

    for (int i = 0; i < lines.Count; i++)
    {
      for (int j = 0; j < source.Count; j++)
      {
        if (lines[i].Touch(source[j]))
        {
          bool test = true;
          for (int k = 0; k < output.Count; k++)
          {
            if (source[j].lineNumber == output[k].lineNumber) test = false;
          }
          if (test) output.Add(source[j]);
        }
      }
    }
    return output;
  }
  public class LDSide
  {
    public int nodeNumber;
    public Point3d point;
    public Vector3d direction;
    public Vector3d normal;
    public bool isEnd;
    public double width;

    public LDSide()
    {
      nodeNumber = -1;
      point = new Point3d(Point3d.Unset);
      direction = new Vector3d(Vector3d.Unset);
      normal = new Vector3d(Vector3d.Unset);
      isEnd = true;
    }

    public LDSide(LDSide side)
    {
      LDSideSet(side.nodeNumber, side.point, side.direction, side.isEnd, side.width, side.normal);
    }
    public LDSide(int n, Point3d pt, Vector3d dir, bool end, double width_calc, Vector3d norm)
    {
      nodeNumber = n;
      point = new Point3d(pt);
      direction = new Vector3d(dir);
      isEnd = end;
      width = width_calc;
      normal = norm;
    }
    public void LDSideSet(int n, Point3d pt, Vector3d dir, bool end, double width_calc, Vector3d norm)
    {
      nodeNumber = n;
      point = new Point3d(pt);
      direction = new Vector3d(dir);
      isEnd = end;
      width = width_calc;
      normal = norm;
    }
    public Curve ToCurve()
    {
      return new LineCurve(point, (Point3d) (point + direction));
    }
  }

  /////////////////////////////////////////////////////
  //public static List<Point3d> MiddleSection(Point3d zero, Vector3d y, Vector3d z, int n, double angle0, double radius, bool zbool, Section sectionCurve)
  public static List<Point3d> EndSection(Point3d zero, Vector3d x, Vector3d y, Vector3d z, int n, double angle0, double radius, bool zbool, Section sectionCurve)
  {
    List<Point3d> output = new List<Point3d>();
    if (zbool)
    {
      for (int i = 0; i < sectionCurve.x_section.Count; i++)
      {
        output.Add(new Point3d(zero + y * sectionCurve.x_section[i] / sectionCurve.heigth_section + z * Math.Sign(angle0) * radius * sectionCurve.z_section[i] / sectionCurve.heigth_section));
      }
    }
    else
    {
      for (int i = 0; i < n; i++)
      {
        output.Add(new Point3d(zero + y * (double) i / (double) (n - 1)));
      }
    }
    return output;
  }
  /////////////////////////////////////////////////////
  public static List<Point3d> MiddleSection(Point3d zero, Vector3d y, Vector3d z, int n, double angle0, double radius, bool zbool, Section sectionCurve)
  {
    List<Point3d> output = new List<Point3d>();
    if (zbool)
    {
      for (int i = 0; i < sectionCurve.x_section.Count; i++)
      {
        output.Add(new Point3d(zero + y * sectionCurve.x_section[i] / sectionCurve.heigth_section + z * Math.Sign(angle0) * radius * sectionCurve.z_section[i] / sectionCurve.heigth_section));
      }
    }
    else
    {
      for (int i = 0; i < n; i++)
      {
        output.Add(new Point3d(zero + y * (double) i / (double) (n - 1)));
      }
    }
    return output;
  }
  /////////////////////////////////////////////////////
  public static Mesh QuarterRotation(List < Point3d > pts, Point3d zero, Vector3d x, Vector3d y, Vector3d z, int nx)
  {
    int ny = pts.Count;
    Rhino.Geometry.Mesh mesh = new Rhino.Geometry.Mesh();
    double angle = 0.0;
    double sign = 1.0;
    if (z * Vector3d.CrossProduct(x, y) < 0.0) sign = -1.0;

    for (int iy = 0; iy < ny; iy++)
    {
      for (int ix = 0; ix < nx; ix++)
      {
        angle = sign * 0.5 * Math.PI * ((double) ix / (double) (nx - 1));

        Point3d point = new Point3d(pts[iy]);
        point.Transform(Transform.Rotation(angle, z, zero));

        mesh.Vertices.Add(new Point3d(point));
      }
    }
    int i0, i1, i2, i3;
    for (int ix = 0; ix < (nx - 1); ix++)
    {
      for (int iy = 0; iy < (ny - 1); iy++)
      {
        i0 = ix + iy * nx;
        i1 = (ix + 1) + iy * nx;
        i2 = (ix + 1) + (iy + 1) * nx;
        i3 = ix + (iy + 1) * nx;
        if (sign > 0) mesh.Faces.AddFace(i0, i1, i2, i3);
        else mesh.Faces.AddFace(i0, i3, i2, i1);
      }
    }
    mesh.Vertices.CombineIdentical(true, true);
    mesh.Normals.ComputeNormals();
    mesh.Compact();
    return mesh;
  }
  /////////////////////////////////////////////////////
  public static Mesh PointsToMesh(List < Point3d > pts1, List<Point3d> pts2, int nx, double puissance, ref DataTree<LineCurve> listUCurves, ref DataTree<LineCurve> listVCurves)
  {
    int ny = pts1.Count;

    Rhino.Geometry.Mesh mesh = new Rhino.Geometry.Mesh();

    for (int iy = 0; iy < ny; iy++)
    {
      for (int ix = 0; ix < nx; ix++)
      {
        mesh.Vertices.Add(new Point3d(pts1[iy] + (pts2[iy] - pts1[iy]) * SFunction((double) ix / (double) (nx - 1), puissance)));
      }
    }
    int i0, i1, i2, i3;
    for (int ix = 0; ix < (nx - 1); ix++)
    {
      for (int iy = 0; iy < (ny - 1); iy++)
      {
        i0 = ix + iy * nx;
        i1 = (ix + 1) + iy * nx;
        i2 = (ix + 1) + (iy + 1) * nx;
        i3 = ix + (iy + 1) * nx;
        mesh.Faces.AddFace(i0, i1, i2, i3);
        listUCurves.Add(new LineCurve(mesh.Vertices[i0], mesh.Vertices[i1]), new GH_Path(iy));
        listVCurves.Add(new LineCurve(mesh.Vertices[i1], mesh.Vertices[i2]), new GH_Path(iy));
        listUCurves.Add(new LineCurve(mesh.Vertices[i2], mesh.Vertices[i3]), new GH_Path(iy + 1));
        listVCurves.Add(new LineCurve(mesh.Vertices[i3], mesh.Vertices[i0]), new GH_Path(iy));
      }
    }
    mesh.Normals.ComputeNormals();
    mesh.Compact();
    return mesh;
  }
  /////////////////////////////////////////////////////
  //S function for x between 0 and 1, and return between 0 et 1
  static double SFunction(double x, double puissance)
  {
    if (x < 0.0) x = 0.0;
    if (x > 1.0) x = 1.0;
    if (puissance <= 0.0) puissance = 0.001;
    double output = 0.0;
    if (x < 0.5)
    {
      output = 0.5 * Math.Pow(x * 2, puissance);
    }
    else
    {
      output = 1 - 0.5 * Math.Pow((1 - x) * 2, puissance);
    }
    return output;
  }
  ///////////////////////////////////////////////////
  public class Section
  {
    public List<double> x_section;
    public List<double> z_section;
    public double heigth_section;

    public Section(List<double> LateralCoordinates, List<double> HeightCoordinates)
    {

      if (LateralCoordinates.Count != HeightCoordinates.Count)
      {
        throw new ArgumentException("There are not the same number of values in x_ and HeightCoordinate");
      }
      else
      {
        if (LateralCoordinates.Count != 0)
        {
          x_section = new List<Double>(LateralCoordinates);
          z_section = new List<Double>(HeightCoordinates);
          heigth_section = Math.Abs(z_section[0] - z_section[z_section.Count - 1]);

          if (heigth_section <= 0.0) throw new ArgumentException("The height (HeigthCoordinates) coordinates of section between first and last point is zero");
        }
        else
        {
          //By default a circle
          x_section = new List<Double>();
          z_section = new List<Double>();
          heigth_section = 1.0;
          double angle = 0.0;
          int nDivisions = 6;
          for (int i = 0; i < nDivisions; i++)
          {
            angle = Math.PI * ( (double) i / (double) (nDivisions - 1) - 0.5);
            x_section.Add(Math.Cos(angle));
            z_section.Add(Math.Sin(angle));
          }
        }
      }
    }
  }
# ---------- end c_script_4 ----------
mesh_4 = Mesh(c_script_4.M)
mjoin = MeshJoin(Meshes=mesh_4)
weldvertices_2 = MeshWeldVertices(Mesh=mjoin, Tolerance=0.01)  # -> RuntimeMessage, Mesh
unifynormals_2 = MeshUnifyNormals(Mesh=weldvertices_2.Mesh)
wbcatmullclark_2 = WeaverbirdsCatmullClarkSubdivision(MeshCurves=unifynormals_2, Level=Slider(0, range=0..3), SmoothNakedEdges=1)

mesh_5 = Mesh(wbcatmullclark_2)
scale_nu = ScaleNU(Geometry=mesh_5, Plane=xz, ScaleX=1, ScaleY=int, ScaleZ=1)  # -> Geometry, Transform
maze_stream = DataSender(A=scale_nu.Geometry, manualmode=False, remotecontroller=False)  # -> Log, StreamId
local_maze_gen = DataSender(A=scale_nu.Geometry, manualmode=False, remotecontroller=False)  # -> Log, StreamId
panel_2 = Panel(local_maze_gen.Log)
panel_3 = Panel(maze_stream.Log)
item_2 = ListItem(List=c_script_2.LPp, Index=0, Wrap=True)  # -> Item, Item1

meshserialize = MeshSerialize(Mesh=mesh_5)
connectsocket = ConnectSocket(Address="http://127.0.0.1:8080", Connect=Toggle(True))  # -> Status, Socket
c_script_5 = CSharpScript(x=meshserialize)  # -> out, A
# ---------- c_script_5: C# usings ----------
using System.IO;
using System.IO.Compression;
# ---------- c_script_5: C# ----------
    MemoryStream output = new MemoryStream();
    using (DeflateStream dstream = new DeflateStream(output, CompressionLevel.Optimal))
    {
      dstream.Write((x as Byte[]), 0, (x as Byte[]).Length);
    }
    A = System.Text.Encoding.ASCII.GetString(output.ToArray());
# ---------- end c_script_5 ----------
c_script_6 = CSharpScript(x=meshserialize)  # -> out, A
# ---------- c_script_6: C# ----------
    A = (x as Byte[]).Length;
# ---------- end c_script_6 ----------
len = TextLength(Text=c_script_5.A)
panel_4 = Panel(connectsocket.Status)
sendmesh = SendMesh(Bytes=meshserialize, Socket=connectsocket.Socket, TargetEvent="gh", Send=Toggle(False))  # -> Status, Length
udp = UDPSender(Port="6001", Pattern="0", Data=c_script_5.A)  # disabled
timer = Timer(TimerInterval=1000)
panel_5 = Panel(c_script_6.A)
panel_6 = Panel(len)
panel_7 = Panel(sendmesh.Length)
panel_8 = Panel(sendmesh.Status)

item_3 = ListItem(List=c_script_2.Pp, Index=item_2.Item, Wrap=True)
item_4 = ListItem(List=c_script_2.Pp, Index=item_2.Item1, Wrap=True)
ln = Line(StartPoint=item_3, EndPoint=item_4)
