# Grasshopper definition WorkingCopy2nomap.gh (Grasshopper 1.0.7)
# plug-ins: UserDataUtils, gHowl

netsource = NetworkSource()  # -> NetworkAdapterIsUp, AdapterProperties, LocalIpAddress
int = Integer(5)
xz = XZPlane(Origin=Point(0, 0, 0))
udp = UDPReceiver(Address="192.168.95.1", Port="8081", Pattern=0)  # -> Info, Data
panel = Panel(udp.Data)
int_2 = Integer(reverse(100))
division = Division(A=panel, B=int_2)
multiplication = Multiplication(A=Slider(2.696, range=2..5), B=division)
scale_nu = ScaleNU(Geometry=[<mesh referenced from the Rhino model> x45], Plane=xz, ScaleX=1, ScaleY=multiplication, ScaleZ=1)  # -> Geometry, Transform
maze_online = DataSender(A=scale_nu.Geometry, manualmode=False, remotecontroller=False)  # -> Log, StreamId
maze_local = DataSender(A=scale_nu.Geometry, manualmode=False, remotecontroller=False)  # -> Log, StreamId
panel_2 = Panel(maze_online.Log)
panel_3 = Panel(maze_local.Log)
