# Grasshopper definition WorkingCopy2nomap.gh (Grasshopper 1.0.7)
# plug-ins: UserDataUtils

int = Integer(5)
xz = XZPlane(Origin=Point(0, 0, 0))
scale_nu = ScaleNU(Geometry=[<mesh referenced from the Rhino model> x45], Plane=xz, ScaleX=1, ScaleY=Slider(2, range=2..5), ScaleZ=1)  # -> Geometry, Transform
maze_online = DataSender(A=scale_nu.Geometry, manualmode=False, remotecontroller=False)  # -> Log, StreamId
maze_local = DataSender(A=scale_nu.Geometry, manualmode=False, remotecontroller=False)  # -> Log, StreamId
panel = Panel(maze_online.Log)
panel_2 = Panel(maze_local.Log)
